# Grasshopper definition CaseStudy5.gh (Grasshopper 1.0.7)
# plug-ins: TetgenGH, GH_to_FEniCSx

# ----
# Make geometry
# By default, internal elements of a volume mesh are not displayed.
# To visualize them, use components from the "Utils" category.
panel = Panel("400")
rectangle = Rectangle(Plane=PlaneXY(0, 0, 0), XSize="1000", YSize="200", Radius=0)  # -> Rectangle, Length
box_rectangle = BoxRectangle(Rectangle=rectangle.Rectangle, Height=panel)

# ----
# Mesh geometry:
number_of_divisions = Slider(7000, range=0..20000)
quad_remesh_settings = QuadRemeshSettings(
    TargetCount=number_of_divisions,
    AdaptiveSize=0,
    AdaptiveCount=False,
    HardEdges=Toggle(True),
    SeamEdges=0,
    Symmetry=0,
    GuideCurves=0)
mesh_brep = MeshBrep(
    Brep=box_rectangle,
    Settings={GridMaxCount=0, GridMinCount=16, JaggedSeams=False, MaxEdgeLength=0, MinEdgeLength=0.0001, MinTolerance=0, Refine=True, RefineAngle=0, RelativeTolerance=0.65, SimplePlanes=True, Tolerance=0})
quad_remesh = QuadRemesh(Mesh=mesh_brep, Settings=quad_remesh_settings)
tetrahedralize = Tetrahedralize(Mesh=quad_remesh, Flags="2", MinRatio=2)  # -> Mesh, Indices, Points
tetrahedralize_2 = Tetrahedralize(Mesh=quad_remesh, Flags="0", MinRatio=2)  # -> Mesh, Indices, Points

mesh_edges = MeshEdges(Mesh=tetrahedralize_2.Mesh)  # -> NakedEdges, InteriorEdges, NonManifoldEdges
list_length = ListLength(List=tetrahedralize_2.Mesh)
brep = Brep(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)

# ----
# Set load and BC:
load_brep = Brep(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)
bc_brep = Brep(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)
infolbc = InfoLBC(Point=tetrahedralize.Points, BC_brep=bc_brep, Load_brep1=load_brep, Load_brep4=brep)  # -> Info, BCPoint, LoadPoint1, LoadPoint2, LoadPoint3, LoadPoint4
loads = Loads(
    XDirection1=0,
    YDirection1=0,
    ZDirection1="-0.5",
    XDirection2=0,
    YDirection2=0,
    ZDirection2=0,
    XDirection3=0,
    YDirection3=0,
    ZDirection3=0,
    XDirection4=0,
    YDirection4="0.5",
    ZDirection4=0)

panel_2 = Panel(list_length)
point = Point(infolbc.LoadPoint1)

# ----
# Send information and solve
collectdata = CollectData(Connectivity=tetrahedralize.Indices, Points=tetrahedralize.Points, Info=infolbc.Info, LoadInfo=loads)  # -> Bool, Time
fenicsxsolver = FEniCSxSolver(Bool=collectdata.Bool)  # -> Bool, Output
display_information_about_solver = Panel(fenicsxsolver.Output)

# ----
# Change to find the node your looking for:
panel_3 = Panel("439")

# ----
# Results
deformation_scaling = Slider(500, range=0..1000000)
results = Results(Bool=fenicsxsolver.Bool, Points=tetrahedralize.Points, Scaliling=deformation_scaling)  # -> DisplacementU, DisplacementV, DisplacementW, MisesStress, DeformedPoints, Time
sort_list = SortList(Keys=results.DisplacementU)  # -> Keys, ValuesValuesA
sort_list_2 = SortList(Keys=results.DisplacementV)  # -> reverse(Keys), ValuesValuesA
sort_list_3 = SortList(Keys=results.DisplacementW)  # -> Keys, ValuesValuesA
sort_list_4 = SortList(Keys=results.MisesStress)  # -> reverse(Keys), ValuesValuesA
max_displacement_u = Panel(sort_list.Keys)
max_displacement_v = Panel(sort_list_2.Keys)
max_displacement_w = Panel(sort_list_3.Keys)
mises_stress = Panel(sort_list_4.Keys)
size_text = Slider(3, range=0..10)
list_length_2 = ListLength(List=tetrahedralize_2.Mesh)
list_item = ListItem(List=tetrahedralize.Points, Index=panel_3, Wrap=True)
list_item_2 = ListItem(List=results.DisplacementW, Index=panel_3, Wrap=True)
list_item_3 = ListItem(List=results.MisesStress, Index=panel_3, Wrap=True)
point_list = PointList(Points=tetrahedralize.Points, Size=size_text)  # disabled
displacement_node_middle = Panel(list_item_2)
nr_of_elements = Panel(list_length_2)
mises_stress_node_middle = Panel(list_item_3)
sphere = Sphere(Base=list_item, Radius=Slider(10, range=0..20))

# ----
# Display deformation and collor pattern:
bounds = Bounds(Numbers=results.MisesStress)
remap_numbers = RemapNumbers(Value=results.MisesStress, Source=bounds, Target=Domain(0, 1))  # -> Mapped, Clipped
topologyconverter = TopologyConverter(Connectivity=tetrahedralize.Indices)
gradient = Gradient(
    LowerLimit=0,
    UpperLimit=1,
    Parameter=remap_numbers.Mapped,
    stops=[0.168: RGB(44, 44, 222), 0.282: RGB(0, 255, 255), 0.42: RGB(0, 255, 0), 0.667: RGB(0, 255, 0), 0.761: RGB(255, 255, 0), 0.919: RGB(255, 0, 0)])
construct_mesh = ConstructMesh(Vertices=results.DeformedPoints, Faces=topologyconverter, Colours=gradient)

mesh_edges_2 = MeshEdges(Mesh=construct_mesh)  # -> NakedEdges, InteriorEdges, NonManifoldEdges
